# Grasshopper definition Gridfinity Laser Generator.gh (Grasshopper 1.0.8)

Y = Slider(2, range=1..20)
X = Slider(3, range=1..20)
Z = Slider(2, range=1..20)
cluster = Cluster_2(Z=Z)  # -> plate_width_length, plate_hole_width_length, bin_insertplate_width_lenght, tollerance_between_plate_and_bin, space_from_hole_to_border_of_plate, radius_of_binplate_and_baseplatehole, magnet_offset_bin_border_to_magnet_cente, magnet_offset_platehole_to_magnet_center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

make_plate_with_magnet_holes = MakePlateWithMagnetHoles(
    X_2=cluster.bin_insertplate_width_lenght,
    R_2=cluster.radius_of_binplate_and_baseplatehole,
    R=cluster.magnet_radius,
    X=cluster.magnet_offset_bin_border_to_magnet_cente)  # -> R_3, G
Z_2 = UnitZ(Factor=cluster.plate_thickness)
Z_3 = UnitZ(Factor=cluster.plate_thickness)
extr = Extrude(Base=make_plate_with_magnet_holes.G, Direction=Z_2)
extr_2 = Extrude(Base=make_plate_with_magnet_holes.R_3, Direction=Z_3)
cap = CapHoles(Brep=extr)
cap_2 = CapHoles(Brep=extr_2)
sdiff = SolidDifference(BrepsA=cap_2, BrepsB=cap)
addition = Addition(A=cluster.tollerance_between_plate_and_bin, B=cluster.space_from_hole_to_border_of_plate)
vec = VectorXYZ(XComponent=addition, YComponent=addition, ZComponent=0)  # -> Vector, Length
move = Move(Geometry=sdiff, Motion=vec.Vector)  # -> Geometry, Transform
arrrec = RectangularArray(Geometry=move.Geometry, Cell=cluster.plate_cell, XCount=X, YCount=Y)  # -> Geometry, Transform

multiplication = Multiplication(A=cluster.plate_width_length, B=X)
multiplication_2 = Multiplication(A=Y, B=cluster.plate_width_length)
box = DomainBox(Base=PlaneXY(0, 0, 0), X=multiplication, Y=cluster.plate_thickness, Z=cluster.height_of_bin_walls)
box_2 = DomainBox(Base=PlaneXY(0, 0, 0), X=multiplication, Y=multiplication_2, Z=cluster.plate_thickness)
box_3 = DomainBox(Base=PlaneXY(0, 0, 0), X=cluster.plate_thickness, Y=multiplication_2, Z=cluster.height_of_bin_walls)
Z_4 = UnitZ(Factor=cluster.plate_thickness)
subtraction = Subtraction(A=multiplication_2, B=cluster.plate_thickness)
subtraction_2 = Subtraction(A=multiplication, B=cluster.plate_thickness)
Y_2 = UnitY(Factor=subtraction)
X_2 = UnitX(Factor=subtraction_2)
move_2 = Move(Geometry=box, Motion=Z_4)  # -> Geometry, Transform
move_3 = Move(Geometry=box_3, Motion=Z_4)  # -> Geometry, Transform
move_4 = Move(Geometry=box_2, Motion=Z_4)  # -> Geometry, Transform
move_5 = Move(Geometry=move_2.Geometry, Motion=Y_2)  # -> Geometry, Transform
move_6 = Move(Geometry=move_3.Geometry, Motion=X_2)  # -> Geometry, Transform
group = Group(Objects=[move_3.Geometry, move_6.Geometry, move_2.Geometry, move_5.Geometry])

bin_walls = Group(Objects=group)
move_7 = Move(Geometry=make_plate_with_magnet_holes.R_3, Motion=vec.Vector)  # -> Geometry, Transform

division = Division(A=cluster.plate_thickness, B="2")
neg = Negative(Value=division)
multiplication_3 = Multiplication(A=division, B="5")
neg_2 = Negative(Value=cluster.plate_thickness)
addition_2 = Addition(A=neg, B=cluster.plate_thickness)
subtraction_3 = Subtraction(A=neg, B=cluster.plate_thickness)
rectangle = Rectangle(Plane=PlaneXY(0, 0, 0), XSize=cluster.plate_thickness, YSize=cluster.plate_thickness, Radius=0)  # -> Rectangle, Length
box_4 = CenterBox(Base=PlaneXY(0, 0, 0), X=division, Y=multiplication_3, Z=division)
box_5 = CenterBox(Base=PlaneXY(0, 0, 0), X=division, Y=division, Z=division)
addition_3 = Addition()
vec_2 = VectorXYZ(XComponent=neg, YComponent=subtraction_3, ZComponent=0)  # -> Vector, Length
vec_3 = VectorXYZ(XComponent=neg, YComponent=addition_2, ZComponent=0)  # -> Vector, Length
Z_5 = UnitZ(Factor=cluster.plate_thickness)
Y_3 = UnitY(Factor=neg_2)
Y_4 = UnitY(Factor=cluster.plate_thickness)
move_8 = Move(Geometry=box_4, Motion=Z_5)  # -> Geometry, Transform
move_9 = Move(Geometry=rectangle.Rectangle, Motion=vec_3.Vector)  # -> Geometry, Transform
move_10 = Move(Geometry=box_5, Motion=Y_4)  # -> Geometry, Transform
move_11 = Move(Geometry=rectangle.Rectangle, Motion=vec_2.Vector)  # -> Geometry, Transform
move_12 = Move(Geometry=box_5, Motion=Y_3)  # -> Geometry, Transform
sunion = SolidUnion(Breps=[move_8.Geometry, move_10.Geometry, move_12.Geometry])
multiplication_4 = Multiplication(A=cluster.plate_width_length, B="12")
fmerge = MergeFaces(Brep=sunion)  # -> Breps, Before, After
Z_6 = UnitZ(Factor=division)
move_13 = Move(Geometry=fmerge.Breps, Motion=Z_6)  # -> Geometry, Transform
subtraction_4 = Subtraction(A="32", B="12")
multiplication_5 = Multiplication(A=cluster.plate_width_length, B=subtraction_4)
division_2 = Division(A=multiplication_4, B="32")
division_3 = Division(A=multiplication_5, B="32")
group_2 = Group(Objects=[move_9.Geometry, move_11.Geometry])
vec_4 = VectorXYZ(XComponent=division_2, YComponent=division_2, ZComponent=0)  # -> Vector, Length
move_14 = Move(Geometry=group_2, Motion=vec_4.Vector)  # -> Geometry, Transform
vec_5 = VectorXYZ(XComponent=division_3, YComponent=division_3, ZComponent=0)  # -> Vector, Length
move_15 = Move(Geometry=group_2, Motion=vec_5.Vector)  # -> Geometry, Transform
rad = Radians(Degrees="45")
xy = XYPlane(Origin=Point(0, 0, 0))
move_16 = Move(Geometry=move_13.Geometry, Motion=vec_5.Vector)  # -> Geometry, Transform
move_17 = Move(Geometry=move_13.Geometry, Motion=vec_4.Vector)  # -> Geometry, Transform
pl_origin = PlaneOrigin(Base=xy, Origin=vec_4.Vector)
rotate = Rotate(Geometry=move_14.Geometry, Angle=rad, Plane=pl_origin)  # -> Geometry, Transform
pl_origin_2 = PlaneOrigin(Base=xy, Origin=vec_5.Vector)
rotate_2 = Rotate(Geometry=move_15.Geometry, Angle=rad, Plane=pl_origin_2)  # -> Geometry, Transform
rotate_3 = Rotate(Geometry=move_16.Geometry, Angle=rad, Plane=pl_origin_2)  # -> Geometry, Transform
rotate_4 = Rotate(Geometry=move_17.Geometry, Angle=rad, Plane=pl_origin)  # -> Geometry, Transform
relay = Relay([rotate_4.Geometry, rotate_3.Geometry])
arrrec_2 = RectangularArray(Geometry=relay, Cell=cluster.plate_cell, XCount=X, YCount=Y)  # -> flatten(Geometry), Transform
sdiff_2 = SolidDifference(BrepsA=move_4.Geometry, BrepsB=arrrec_2.Geometry)
sdiff_3 = SolidDifference(BrepsA=arrrec.Geometry, BrepsB=arrrec_2.Geometry)

bin_buttom_plate = Group(Objects=sdiff_2)
bin_connection_plates = Group(Objects=sdiff_3)

make_plate_with_magnet_holes_2 = MakePlateWithMagnetHoles(
    X_2=cluster.plate_hole_width_length,
    R_2=cluster.radius_of_binplate_and_baseplatehole,
    R=cluster.magnet_radius,
    X=cluster.magnet_offset_platehole_to_magnet_center)  # -> R_3, G
vec_6 = VectorXYZ(
    XComponent=cluster.space_from_hole_to_border_of_plate,
    YComponent=cluster.space_from_hole_to_border_of_plate,
    ZComponent=0)  # -> Vector, Length
vec_7 = VectorXYZ(
    XComponent=cluster.space_from_hole_to_border_of_plate,
    YComponent=cluster.space_from_hole_to_border_of_plate,
    ZComponent=0)  # -> Vector, Length
cluster_2 = Cluster(A_2=cluster.plate_hole_width_length, B=X, A=cluster.space_from_hole_to_border_of_plate)
cluster_3 = Cluster(A_2=cluster.plate_hole_width_length, B=Y, A=cluster.space_from_hole_to_border_of_plate)
move_18 = Move(Geometry=make_plate_with_magnet_holes_2.G, Motion=vec_6.Vector)  # -> Geometry, Transform
move_19 = Move(Geometry=[make_plate_with_magnet_holes_2.R_3, make_plate_with_magnet_holes_2.G], Motion=vec_7.Vector)  # -> Geometry, Transform
arrrec_3 = RectangularArray(Geometry=move_18.Geometry, Cell=cluster.plate_cell, XCount=X, YCount=Y)  # -> flatten(Geometry), Transform
rectangle_2 = Rectangle(Plane=PlaneXY(0, 0, 0), XSize=cluster_2, YSize=cluster_3, Radius=cluster.radius_of_binplate_and_baseplatehole)  # -> Rectangle, Length
multiplication_6 = Multiplication(A=cluster.plate_width_length, B=Y)
arrrec_4 = RectangularArray(Geometry=[rotate.Geometry, rotate_2.Geometry], Cell=cluster.plate_cell, XCount=X, YCount=Y)  # -> flatten(Geometry), Transform
arrrec_5 = RectangularArray(Geometry=[move_19.Geometry, move_7.Geometry], Cell=cluster.plate_cell, XCount=X, YCount=Y)  # -> flatten(Geometry), Transform
addition_4 = Addition(A=multiplication_6, B="2")
Y_5 = UnitY(Factor=addition_4)
group_3 = Group(Objects=[arrrec_5.Geometry, rectangle_2.Rectangle, arrrec_4.Geometry])
move_20 = Move(Geometry=[arrrec_3.Geometry, rectangle_2.Rectangle], Motion=Y_5)  # -> Geometry, Transform

plate_second_layer_and_bin_connectorplat = Group(Objects=group_3)  # "Plate Second layer and bin connectorPlates"
plate_buttom = Group(Objects=move_20.Geometry)

move_21 = Move(Geometry=make_plate_with_magnet_holes_2.R_3, Motion=vec_7.Vector)  # -> Geometry, Transform
arrrec_6 = RectangularArray(Geometry=move_21.Geometry, Cell=cluster.plate_cell, XCount=X, YCount=Y)  # -> flatten(Geometry), Transform
rectangle_3 = Rectangle(Plane=PlaneXY(0, 0, 0), XSize=cluster_2, YSize=cluster_3, Radius=0)  # -> Rectangle, Length
Z_7 = UnitZ(Factor=cluster.plate_thickness)
addition_5 = Addition(A=cluster.height_of_bin_walls, B=cluster.plate_thickness)
Z_8 = UnitZ(Factor=addition_5)
extr_3 = Extrude(Base=rectangle_3.Rectangle, Direction=Z_7)
extr_4 = Extrude(Base=arrrec_6.Geometry, Direction=Z_7)
cap_3 = CapHoles(Brep=extr_3)
cap_4 = CapHoles(Brep=extr_4)
move_22 = Move(Geometry=cap_4, Motion=Z_8)  # -> Geometry, Transform
move_23 = Move(Geometry=cap_3, Motion=Z_8)  # -> Geometry, Transform
sdiff_4 = SolidDifference(BrepsA=move_23.Geometry, BrepsB=move_22.Geometry)

bin_top_3d = Group(Objects=sdiff_4)

rectangle_4 = Rectangle(Plane=PlaneXY(0, 0, 0), XSize=cluster_2, YSize=cluster_3, Radius=0)  # -> Rectangle, Length
group_4 = Group(Objects=[arrrec_5.Geometry, arrrec_4.Geometry, rectangle_4.Rectangle])

bin_top_2d_with_bin_connector_plates = Group(Objects=group_4)

m2d_rhino = Make2DRhinoView(Name="Right", Clip=True)
make2d = Make2D(Geometry=move_13.Geometry, View=m2d_rhino, TangentEdges=False, TangentSeams=False, AutoComputeMake2D=True)  # -> VisibleCurves, VisibleIndex, VisibleType, HiddenCurves, HiddenIndex, HiddenType
multiplication_7 = Multiplication(A=cluster.plate_thickness, B="2")
multiplication_8 = Multiplication(A=multiplication_3, B="2")
addition_6 = Addition(A=multiplication_7, B="1")
addition_7 = Addition(A=multiplication_8, B="1")
rectangle_5 = Rectangle(Plane=PlaneXY(0, 0, 0), XSize=addition_7, YSize=addition_6, Radius=0)  # -> Rectangle, Length
multiplication_9 = Multiplication(A=X, B="2")
neg_3 = Negative(Value=Slider(20, range=0..100))
addition_8 = Addition(A=multiplication_9, B="1")
arrrec_7 = RectangularArray(Geometry=flatten(make2d.VisibleCurves), Cell=rectangle_5.Rectangle, XCount=addition_8, YCount=Y)  # -> flatten(Geometry), Transform
vec_8 = VectorXYZ(XComponent=neg_3, YComponent=neg_3, ZComponent=0)  # -> Vector, Length
move_24 = Move(Geometry=arrrec_7.Geometry, Motion=vec_8.Vector)  # -> Geometry, Transform

laser_nails = Group(Objects=move_24.Geometry)

# ==== cluster Cluster
B = ClusterInput()
A = ClusterInput()
A_2 = ClusterInput()
multiplication = Multiplication(A=A, B="2")
multiplication_2 = Multiplication(A=B, B=multiplication)
multiplication_3 = Multiplication(A=A_2, B=B)
addition = Addition(A=multiplication_3, B=multiplication_2)
R = ClusterOutput(addition)

# ==== cluster MakePlateWithMagnetHoles
X = ClusterInput()
R = ClusterInput()
X_2 = ClusterInput()
R_2 = ClusterInput()
subtraction = Subtraction(A=X_2, B=X)
rectangle = Rectangle(Plane=PlaneXY(0, 0, 0), XSize=X_2, YSize=X_2, Radius=R_2)  # -> Rectangle, Length
cir = Circle(Plane=PlaneXY(0, 0, 0), Radius=R)
vec = VectorXYZ(XComponent=X, YComponent=X, ZComponent=0)  # -> Vector, Length
vec_2 = VectorXYZ(XComponent=X, YComponent=subtraction, ZComponent=0)  # -> Vector, Length
vec_3 = VectorXYZ(XComponent=subtraction, YComponent=X, ZComponent=0)  # -> Vector, Length
vec_4 = VectorXYZ(XComponent=subtraction, YComponent=subtraction, ZComponent=0)  # -> Vector, Length
move = Move(Geometry=cir, Motion=vec.Vector)  # -> Geometry, Transform
move_2 = Move(Geometry=cir, Motion=vec_2.Vector)  # -> Geometry, Transform
move_3 = Move(Geometry=cir, Motion=vec_3.Vector)  # -> Geometry, Transform
move_4 = Move(Geometry=cir, Motion=vec_4.Vector)  # -> Geometry, Transform
R_3 = ClusterOutput(rectangle.Rectangle)
G = ClusterOutput([move.Geometry, move_2.Geometry, move_3.Geometry, move_4.Geometry])

# ==== cluster Cluster_2
Z = ClusterInput()  # z
panel = Panel("Height Increments")

panel_2 = Panel("Plate Width/Length")
number_slider = Slider(42, range=0..100)
stupid = Stupid(A=number_slider)
plate_width_length = ClusterOutput(stupid)  # Plate Width/Length

panel_3 = Panel("Bin InsertPlate width/lenght")
number_slider_2 = Slider(37.15, range=0..100)
stupid_2 = Stupid(A=number_slider_2)
bin_insertplate_width_lenght = ClusterOutput(stupid_2)

panel_4 = Panel("Plate Hole Width/Length")
number_slider_3 = Slider(37.65, range=0..100)
stupid_3 = Stupid(A=number_slider_3)
plate_hole_width_length = ClusterOutput(stupid_3)

panel_5 = Panel("Magnet Radius")
stupid_4 = Stupid(A=Slider(3.5, range=0..10))
magnet_radius = ClusterOutput(stupid_4)

panel_6 = Panel("Plate thickness")
stupid_5 = Stupid(A=Slider(3, range=0..10))
plate_thickness = ClusterOutput(stupid_5)

panel_7 = Panel("Plate Cell")

# ----
# Radius of BinPlate And BasePlateHole
number_slider_4 = Slider(1.6, range=0..10)
stupid_6 = Stupid(A=number_slider_4)
radius_of_binplate_and_baseplatehole = ClusterOutput(stupid_6)

# ----
# Magnet Offset, Bin border to magnet center
number_slider_5 = Slider(5.57, range=0..10)
stupid_7 = Stupid(A=number_slider_5)
magnet_offset_bin_border_to_magnet_cente = ClusterOutput(stupid_7)

multiplication = Multiplication(A=Slider(40, range=0..100), B=Z)

panel_8 = Panel("Height")
height_of_bin_walls = ClusterOutput(multiplication)
panel_9 = Panel(multiplication)

# ----
# Space from hole to Border of plate
subtraction = Subtraction(A=number_slider, B=number_slider_3)
division = Division(A=subtraction, B="2")
panel_10 = Panel(division)

# ----
# Tollerance between Plate and Bin
subtraction_2 = Subtraction(A=number_slider_3, B=number_slider_2)
division_2 = Division(A=subtraction_2, B="2")
tollerance_between_plate_and_bin = ClusterOutput(division_2)
panel_11 = Panel(division_2)

space_from_hole_to_border_of_plate = ClusterOutput(division)

# ----
# Magnet Offset, PlateHole to Magnet center
addition = Addition(A=division_2, B=number_slider_5)
magnet_offset_platehole_to_magnet_center = ClusterOutput(addition)
panel_12 = Panel(addition)

rectangle = Rectangle(Plane=PlaneXY(0, 0, 0), XSize=number_slider, YSize=number_slider, Radius=0)  # -> Rectangle, Length
plate_cell = ClusterOutput(rectangle.Rectangle)

# ==== cluster Stupid
A = ClusterInput()
multiplication = Multiplication(A=A, B=Slider(1, range=0..1))
R = ClusterOutput(multiplication)
